# Grasshopper definition SerializeToFasterReadableJsonNoMongo.gh (Grasshopper 1.0.7)
# plug-ins: BH.UI.Grasshopper

panel = Panel("C:\Users\alombardi\GitHub\DiffingTests_Prototypes\Datasets\")
panel_2 = Panel("C:\Users\alombardi\GitHub\DiffingTests_Prototypes\Datasets\RevitDiffing-duplicateIdsStructuralObjs_following1.json")
concat = Concatenate(FragmentA=panel, FragmentB="RevitDiffing-duplicateIdsStructuralObjs_following.json")
readfromjsonfile = ReadFromJsonFile(FilePath=concat, Active=Toggle(False), Component="{ .ReadFromJsonFile")
dam = DataDam(DataA=readfromjsonfile, BufferDelay=10000000, BufferMode=0)
serialisetojsonfile = SerialiseToJsonFile(Obj=dam, FilePath=panel_2, Component="{ .SerialiseToJsonFile")
